# Grasshopper definition maze.gh (Grasshopper 1.0.7)

# ----
# Width of the maze
number_slider = Slider(9, range=0..10)
width = GetNumber(number_slider, AtLeast=1, AtMost=1, Maximum=1.797693135e+308, Minimum=-1.797693135e+308)

# ----
# Length of the maze
number_slider_2 = Slider(8, range=0..10)
length = GetNumber(number_slider_2, AtLeast=1, AtMost=1, Maximum=1.797693135e+308, Minimum=-1.797693135e+308)

square = Square(Plane=PlaneXY(0, 0, 0), Size=Slider(8, range=0..10), ExtentX=width, ExtentY=length)  # -> flatten(Cells), Points

# ----
# The maze pattern
number_slider_3 = Slider(3, range=0..10)
seed_value = GetNumber(number_slider_3, AtLeast=1, AtMost=1, Maximum=1.797693135e+308, Minimum=-1.797693135e+308)

list_length = ListLength(List=square.Cells)
random = Random(Range=Domain(0, 1), Number=list_length, Seed=seed_value, Integers=True)
dispatch = Dispatch(List=square.Cells, DispatchPattern=random)  # -> ListA, ListB
explode = Explode(Curve=dispatch.ListA, Recursive=True)  # -> Segments, Vertices
explode_2 = Explode(Curve=dispatch.ListB, Recursive=True)  # -> Segments, Vertices
list_item = ListItem(List=explode.Segments, Index=0, Wrap=True)  # -> Item, Item1, Item2, Item3
list_item_2 = ListItem(List=explode_2.Segments, Index=0, Wrap=True)  # -> Item, Item1, Item2, Item3
unit_y = UnitY(Factor=1)
unit_x = UnitX(Factor=1)
point_on_curve = PointOnCurve(list_item_2.Item, parameter=0.5)
point_on_curve_2 = PointOnCurve(list_item_2.Item3, parameter=0.5)
point_on_curve_3 = PointOnCurve(list_item.Item, parameter=0.5)
point_on_curve_4 = PointOnCurve(list_item.Item1, parameter=0.5)
arc_sed = ArcSED(Start=point_on_curve_3, End=point_on_curve_4, Direction=unit_y)  # -> Arc, Plane, Radius
arc_sed_2 = ArcSED(Start=point_on_curve_2, End=point_on_curve, Direction=unit_x)  # -> Arc, Plane, Radius
list_item_3 = ListItem(List=explode_2.Vertices, Index=[Slider(3, range=0..10), Slider(1, range=0..100)], Wrap=True)
list_item_4 = ListItem(List=explode.Vertices, Index=[Slider(2, range=0..10), Slider(0, range=0..100)], Wrap=True)
polyline = PolyLine(Vertices=list_item_4, Closed=False)
polyline_2 = PolyLine(Vertices=list_item_3, Closed=False)
mirror_curve = MirrorCurve(Geometry=arc_sed.Arc, Curve=polyline, Tangent=True)
mirror_curve_2 = MirrorCurve(Geometry=arc_sed_2.Arc, Curve=polyline_2, Tangent=True)
join_curves = JoinCurves(Curves=[mirror_curve, arc_sed.Arc, arc_sed_2.Arc, mirror_curve_2], Preserve=False)
number_slider_4 = Slider(0.6, range=0..1)
curve = Curve(join_curves)
negative = Negative(Value=number_slider_4)
offset_curve = OffsetCurve(Curve=curve, Distance=number_slider_4, Corners=1)
offset_curve_2 = OffsetCurve(Curve=curve, Distance=negative, Corners=1)

# ----
# Height of the maze
number_slider_5 = Slider(9, range=1..9)
height = GetNumber(number_slider_5, AtLeast=1, AtMost=1, Maximum=1.797693135e+308, Minimum=-1.797693135e+308)

loft = Loft(
    Curves=[offset_curve, offset_curve_2],
    Options={Adjust=False, Closed=False, LoftEnds=0, LoftSimp=0, LoftType=0, Rebuild=10, Refit=0.01})
unit_z = UnitZ(Factor=height)
extrude = Extrude(Base=loft, Direction=unit_z)
mesh = Mesh(extrude)
deconstruct_mesh = DeconstructMesh(Mesh=mesh)  # -> Vertices, Faces, Colours, Normals
deconstruct = Deconstruct(Point=deconstruct_mesh.Vertices)  # -> XComponent, YComponent, ZComponent
bounds = Bounds(Numbers=deconstruct.ZComponent)
deconstruct_domain = DeconstructDomain(Domain=bounds)  # -> Start, End
gradient = Gradient(
    LowerLimit=deconstruct_domain.Start,
    UpperLimit=deconstruct_domain.End,
    Parameter=deconstruct.ZComponent,
    stops=[0: RGB(209, 253, 255), 0.539: RGB(3, 247, 255), 0.887: RGB(11, 69, 117)])
construct_mesh = ConstructMesh(Vertices=deconstruct_mesh.Vertices, Faces=deconstruct_mesh.Faces, Colours=gradient)

# ---- group: RH_OUT:mesh
mesh_2 = Mesh(flatten(construct_mesh))
